# Grasshopper definition Accurate_Polish_sunlight_hours_compilance.gh (Grasshopper 1.0.7)
# plug-ins: Human UI, Human

panel = Panel("""1
2
3
4
5
6
10
12
15
20
30
60""")
number_slider = Slider(60, range=0..100)
division = Division(A=number_slider, B=panel)
pulldown = CreatePulldownMenu(Label="DOKŁADNOŚĆ [min]", ListItems=division, SelectedIndex=Slider(7, range=0..10), showLabel=True)
values = ValueListener(Elements=pulldown, SomeProperty=True)  # -> Values, Indices
division_2 = Division(A=number_slider, B=values.Values)

dom = ConstructDomain(DomainStart=Slider(7, range=0..100), DomainEnd=Slider(17, range=0..100))
dom_2 = ConstructDomain(DomainStart=Slider(0, range=0..100), DomainEnd=Slider(23, range=0..100))
tb = CreateTextBlock(Text="ZAKRES CZASOWY ANALIZY", TextSize=12, Justification=0)
rangeslider = CreateRangeSlider(SliderRange=dom_2, StartingRange=dom)
values_2 = ValueListener(Elements=rangeslider, SomeProperty=True)  # -> Values, Indices
dedomain = DeconstructDomain(Domain=values_2.Values)  # -> Start, End
int = Integer(dedomain.Start)
int_2 = Integer(dedomain.End)

series = Series(Start=Slider(1, range=0..1), Step=1, Count=Slider(31, range=0..100))
series_2 = Series(Start=Slider(1, range=0..1), Step=1, Count=Slider(2, range=0..100))
series_3 = Series(Start=Slider(1, range=0..1), Step=1, Count=Slider(12, range=0..100))
pulldown_2 = CreatePulldownMenu(Label="DZIEŃ", ListItems=series, SelectedIndex=Slider(19, range=0..100), showLabel=True)
pulldown_3 = CreatePulldownMenu(Label="UTC +", ListItems=series_2, SelectedIndex=Slider(0, range=0..100), showLabel=True)
tb_2 = CreateTextBlock(Text="RÓWNONOC WIOSENNA", TextSize=12, Justification=0)
pulldown_4 = CreatePulldownMenu(Label="MIESIĄC", ListItems=series_3, SelectedIndex=Slider(2, range=0..100), showLabel=True)
values_3 = ValueListener(Elements=pulldown_2, SomeProperty=True)  # -> Values, Indices
values_4 = ValueListener(Elements=pulldown_3, SomeProperty=True)  # -> Values, Indices
values_5 = ValueListener(Elements=pulldown_4, SomeProperty=True)  # -> Values, Indices

series_4 = Series(Start=Slider(1, range=0..1), Step=1, Count=Slider(31, range=0..100))
series_5 = Series(Start=Slider(1, range=0..1), Step=1, Count=Slider(2, range=0..100))
series_6 = Series(Start=Slider(1, range=0..1), Step=1, Count=Slider(12, range=0..100))
pulldown_5 = CreatePulldownMenu(Label="DZIEŃ", ListItems=series_4, SelectedIndex=Slider(21, range=0..100), showLabel=True)
pulldown_6 = CreatePulldownMenu(Label="UTC +", ListItems=series_5, SelectedIndex=Slider(1, range=0..100), showLabel=True)
tb_3 = CreateTextBlock(Text="RÓWNONOC JESIENNA", TextSize=12, Justification=0)
pulldown_7 = CreatePulldownMenu(Label="MIESIĄC", ListItems=series_6, SelectedIndex=Slider(8, range=0..100), showLabel=True)
values_6 = ValueListener(Elements=pulldown_5, SomeProperty=True)  # -> Values, Indices
values_7 = ValueListener(Elements=pulldown_6, SomeProperty=True)  # -> Values, Indices
values_8 = ValueListener(Elements=pulldown_7, SomeProperty=True)  # -> Values, Indices

textbox = CreateTextBox(Label="MIEJSCOWOŚĆ", DefaultText="Lublin", UpdateButton=True, showLabel=True)
textbox_2 = CreateTextBox(Label="KOORDYNATY", DefaultText="51.24957590033782,22.55452922746104", UpdateButton=True, showLabel=True)
textbox_3 = CreateTextBox(Label="WYSOKOŚĆ NPM [m]", DefaultText="114", UpdateButton=True, showLabel=True)
values_9 = ValueListener(Elements=textbox_3, SomeProperty=True)  # -> Values, Indices
values_10 = ValueListener(Elements=textbox, SomeProperty=True)  # -> Values, Indices
values_11 = ValueListener(Elements=textbox_2, SomeProperty=True)  # -> Values, Indices

panel_2 = Panel("""2020
2021
2022
2023
2024
2025""")
series_7 = Series(Start=Slider(0.1, range=0..0.1), Step=Slider(0.1, range=0..0.1), Count=Slider(10, range=0..10))
separator = CreateSeparator(Thickness=0.5, Horizontal=True, Color=RGB(0, 0, 0))
pulldown_8 = CreatePulldownMenu(Label="ROK", ListItems=panel_2, SelectedIndex=Slider(2021, range=0..10000), showLabel=True)
separator_2 = CreateSeparator(Thickness=0.5, Horizontal=True, Color=RGB(0, 0, 0))
separator_3 = CreateSeparator(Thickness=0.5, Horizontal=True, Color=RGB(0, 0, 0))
pulldown_9 = CreatePulldownMenu(Label="GRID SIZE [m]", ListItems=series_7, SelectedIndex=Slider(4, range=0..10), showLabel=True)  # -> flatten(Pulldown)
merge = Merge(Data1=textbox, Data2=textbox_2, Data3=textbox_3)  # -> flatten(Result)
separator_4 = CreateSeparator(Thickness=0.5, Horizontal=True, Color=RGB(0, 0, 0))
separator_5 = CreateSeparator(Thickness=0.5, Horizontal=True, Color=RGB(0, 0, 0))
separator_6 = CreateSeparator(Thickness=0.5, Horizontal=True, Color=RGB(0, 0, 0))
merge_2 = Merge(Data1=separator_3, Data2=tb_3, Data3=pulldown_5, Data4=pulldown_7, Data5=pulldown_6)  # -> flatten(Result)
merge_3 = Merge(Data1=separator_2, Data2=tb, Data3=rangeslider, Data4=pulldown)  # -> flatten(Result)
merge_4 = Merge(Data1=pulldown_8)  # -> flatten(Result)
merge_5 = Merge(Data1=separator, Data2=tb_2, Data3=pulldown_2, Data4=pulldown_4, Data5=pulldown_3)  # -> flatten(Result)
values_12 = ValueListener(Elements=pulldown_8, SomeProperty=True)  # -> Values, Indices
values_13 = ValueListener(Elements=pulldown_9, SomeProperty=True)  # -> Values, Indices
launchxpwin = LaunchTransparentWindow(Show=Toggle(True), Name="LINIJKA SŁOŃCA", Width=370, Height="700", ChildStatus=1, EnableHorizScroll=False)

toggle = CreateToggle(Default=False, Label="START!")
values_14 = ValueListener(Elements=toggle, SomeProperty=True)  # -> Values, Indices

winprops = SetWindowProperties(Window=launchxpwin, ShowTitleBar=True, ScaleFactor=1)

wysokosc_szerkosc_geo = Panel(values_11.Values)
# LOKALIZACJA
wysokosc_npm = Panel(values_9.Values)
# RÓWNONOC WIOSENNA
# RÓWNONOC JESIENNA
lokalizacja = Panel(values_10.Values)

grid_size = Slider(0.5, range=0..1)

split = TextSplit(Text=wysokosc_szerkosc_geo, Separators=",")
merge_6 = Merge(Data1=values_6.Values, Data2=values_8.Values, Data3=values_12.Values)
merge_7 = Merge(Data1=values_3.Values, Data2=values_5.Values, Data3=values_12.Values)  # -> flatten(Result)
item = ListItem(List=split, Index=Slider(1, range=0..1), Wrap=True)
join = TextJoin(Text=merge_7, Join=".")
join_2 = TextJoin(Text=merge_6, Join=".")
item_2 = ListItem(List=split, Index=Slider(0, range=0..1), Wrap=True)

# ----
# RÓWNONOC WIOSENNA
analysisperiod = LBAnalysisPeriod(
    start_month=values_5.Values,
    start_day=values_3.Values,
    start_hour=int,
    end_month=values_5.Values,
    end_day=values_3.Values,
    end_hour=int_2,
    timestep=division_2)  # -> period, hoys, dates; plug-in component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

# ----
# RÓWNONOC JESIENNA
analysisperiod_2 = LBAnalysisPeriod(
    start_month=values_8.Values,
    start_day=values_6.Values,
    start_hour=int,
    end_month=values_8.Values,
    end_day=values_6.Values,
    end_hour=int_2,
    timestep=division_2)  # -> period, hoys, dates; plug-in component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

join_3 = TextJoin(Text=[lokalizacja, join], Join=", ")
join_4 = TextJoin(Text=[lokalizacja, join_2], Join=", ")
entwine = Entwine(Branch00=analysisperiod.hoys, Branch01=analysisperiod_2.hoys, FlattenInputs=True)
constrloc = LBConstructLocation(name=join_3, latitude=item_2, longitude=item, time_zone=values_4.Values, elevation=wysokosc_npm)  # -> location; plug-in component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
constrloc_2 = LBConstructLocation(name=join_4, latitude=item_2, longitude=item, time_zone=values_7.Values, elevation=wysokosc_npm)  # -> location; plug-in component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
entwine_2 = Entwine(Branch00=constrloc, Branch01=constrloc_2, FlattenInputs=True)
division_3 = Division(A=1, B=division_2)
panel_3 = Panel("MAPA MINIMALNEGO CZASU BEZPOŚREDNIEGO NASŁONECZNIENIA W DNIACH")
number_slider_2 = Slider(2.2, range=0..10)
join_5 = TextJoin(Text=[join_2, join], Join=" ORAZ ")
join_6 = TextJoin(Text=[panel_3, join_5], Join=" ")

# ----
# LEGENDA
number_slider_3 = Slider(21, range=0..100)
series_8 = Series(Start=0, Step=1, Count=number_slider_3)
rev = ReverseList(List=series_8)
gradient = Gradient(
    LowerLimit=0,
    UpperLimit=number_slider_3,
    Parameter=rev,
    stops=[0: RGB(255, 165, 0), 0.25: RGB(255, 165, 0), 0.63: RGB(255, 165, 0), 0.7: RGB(255, 165, 0), 0.85: RGB(255, 255, 0), 1: RGB(65, 105, 225)])
legendpar = LBLegendParameters(
    min=Slider(0, range=0..100),
    max=Slider(10, range=0..10),
    seg_count=number_slider_3,
    colors=gradient,
    num_decimals=1,
    seg_height=number_slider_2,
    seg_width=number_slider_2)  # -> leg_par; plug-in component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
pt = Point(Point(28.96068794, -25.93356048, 0))
createlegend = LBCreateLegend(values=rev, base_plane=pt, title="CZAS [h]", legend_par=legendpar)  # -> mesh, title_obj, label_objs, label_text, colors; plug-in component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

Z = UnitZ(Factor=Slider(0.1, range=0..0.1))

pickbtn = CreateRhinoPickButton(
    ButtonName="KONTEKST",
    Prompt="Wybierz geometrię zacieniajacą",
    AllowMultiple=True,
    AllowNone=True,
    Type=0,
    ButtonStyle=0)
pickbtn_2 = CreateRhinoPickButton(ButtonName="GEOMETRIA", Prompt="Wybierz płaszczyznę analizy", AllowMultiple=True, AllowNone=True, Type=0, ButtonStyle=0)
values_15 = ValueListener(Elements=pickbtn, SomeProperty=True)  # -> Values, Indices
values_16 = ValueListener(Elements=pickbtn_2, SomeProperty=True)  # -> Values, Indices
geo = Geometry(values_16.Values)
geo_2 = Geometry(values_15.Values)
sortbytype = SortObjectsByType(RhinoObjects=geo)  # -> Points, Curves, Surfaces, Breps, Meshes, TextObjects, HatchObjects, LightObjects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
geo_3 = Geometry([sortbytype.Breps, sortbytype.Meshes, sortbytype.Extrusions, sortbytype.Surfaces])
preview = CustomPreview(Geometry=geo_3, Material=ColourSwatch(SwatchColor=RGB(176, 176, 176)))

merge_8 = Merge(Data1=pickbtn_2, Data2=pulldown_9, Data3=pickbtn)  # -> flatten(Result)
stack = CreateStack(UIElements=merge_8, Horizontal=Toggle(True))
merge_9 = Merge(
    Data1=stack,
    Data2=separator_4,
    Data3=merge,
    Data4=separator_5,
    Data5=merge_4,
    Data6=merge_5,
    Data7=merge_2,
    Data8=merge_3,
    Data9=separator_6,
    Data10=toggle)
cluster = Cluster(rhobj=geo_2)

geo_4 = Geometry(cluster)
preview_2 = CustomPreview(Geometry=geo_4, Material=ColourSwatch(SwatchColor=RGB(224, 224, 224)))

tabs = TabbedView(TabNames="DANE", TabTextSize=Slider(15, range=0..100), Tab0=flatten(merge_9))
addelems = AddElements(Window=launchxpwin, Elements=flatten(tabs), DoVLChecking=True)  # -> AddedElements, ElementNames
bbox = BoundingBox(Content=geo_3, Plane=PlaneXY(0, 0, 0), UnionBox=True)  # -> Box, Box_2
# CENTER POINT OF ANALYZE
# GEOMETRIA INPUT
boxprop = BoxProperties(Box=bbox.Box)  # -> Center, Diagonal, Area, Volume, Degeneracy
pt_2 = Point(boxprop.Center)

context = Geometry(geo_4)
analyze_geometry = Brep(geo_3)

sunpath = LBSunPath(location=entwine_2, hoys=entwine, solar_time=Toggle(False), center_pt=pt_2, scale=Slider(0.4, range=0..1))  # -> report, simplify(vectors), altitudes, azimuths, hoys, sun_pts, analemma, daily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; plug-in component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
bang = ExplodeTree(Data=sunpath.vectors)  # -> Branch0, Branch1
preview_3 = CustomPreview(Geometry=[sunpath.compass, sunpath.daily], Material=ColourSwatch(SwatchColor=RGB(255, 251, 0)))

lng = ListLength(List=analysisperiod.hoys)

series_9 = Series(Start=0, Step=1, Count=lng)
rev_2 = ReverseList(List=series_9)
gradient_2 = Gradient(
    LowerLimit=0,
    UpperLimit=lng,
    Parameter=rev_2,
    stops=[0: RGB(255, 165, 0), 0.25: RGB(255, 165, 0), 0.63: RGB(255, 165, 0), 0.7: RGB(255, 165, 0), 0.85: RGB(255, 255, 0), 1: RGB(65, 105, 225)])

legendpar_2 = LBLegendParameters(
    min=Slider(0, range=0..100),
    max=Slider(10, range=0..10),
    seg_count=lng,
    colors=gradient_2,
    num_decimals=Slider(1, range=0..100),
    seg_height=Slider(1, range=0..1),
    seg_width=Slider(1, range=0..1))  # -> leg_par; plug-in component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

# ----
# RÓWNONOC WIOSENNA
directsunhours = LBDirectSunHours(
    vectors=flatten(bang.Branch0),
    timestep=division_2,
    geometry=flatten(analyze_geometry),
    context=flatten(context),
    grid_size=values_13.Values,
    legend_par=legendpar_2,
    run=values_14.Values)  # -> report, points, results, mesh, legend, title, int_mtx; plug-in component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

# ----
# RÓWNONOC JESIENNA
directsunhours_2 = LBDirectSunHours(
    vectors=flatten(bang.Branch1),
    timestep=division_2,
    geometry=flatten(analyze_geometry),
    context=flatten(context),
    grid_size=values_13.Values,
    legend_par=legendpar_2,
    run=values_14.Values)  # -> report, points, results, mesh, legend, title, int_mtx; plug-in component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

# ---- group: NAJMNIEJSZY CZAS Z DW
subtraction = Subtraction(A=directsunhours.results, B=division_3)
subtraction_2 = Subtraction(A=directsunhours_2.results, B=division_3)
entwine_3 = Entwine(Branch00=subtraction, Branch01=subtraction_2, FlattenInputs=True)
flip = FlipMatrix(Data=entwine_3)
sort = SortList(Keys=flip)  # -> Keys, ValuesA
item_3 = ListItem(List=sort.Keys, Index=Slider(0, range=0..100), Wrap=True)  # -> flatten(Item)

# ----
# RÓWNONOC WIOSENNA + JESIENNA
heatmap = LBSpatialHeatmap(values=item_3, mesh=directsunhours.mesh, legend_par=legendpar_2, global_title=join_6)  # -> mesh, legend, title, colors, legend_par; plug-in component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

move = Move(Geometry=heatmap.mesh, Motion=Z)  # -> Geometry, Transform

preview_4 = CustomPreview(
    Geometry=[move.Geometry, heatmap.title],
    Material={diffuse=RGB(221, 160, 221), emission=RGB(66, 48, 66), shine=0.5, specular=RGB(255, 255, 255), transparency=0})

# ==== cluster Cluster
rhobj = ClusterInput()
sortbytype = SortObjectsByType(RhinoObjects=rhobj)  # -> Points, Curves, Surfaces, Breps, Meshes, TextObjects, HatchObjects, LightObjects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
blockexplode_r = ExplodeBlocksRecursively(BlockObjects=graft(sortbytype.Blocks))  # -> flatten(Geometry), Attributes, BlockNames, BoundingBox, BlockTransforms
sortbytype_2 = SortObjectsByType(RhinoObjects=blockexplode_r.Geometry)  # -> Points, Curves, Surfaces, Breps, Meshes, TextObjects, HatchObjects, LightObjects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
geo = Geometry(flatten([sortbytype.Breps, sortbytype.Surfaces, sortbytype.Meshes, sortbytype_2.Surfaces, sortbytype_2.Breps, sortbytype_2.Meshes]))
geo_2 = ClusterOutput(geo)
